# Grasshopper definition TerrainSnapshotBranches.gh (Grasshopper 1.0.8)
# plug-ins: MoleHill

terrain_snapshot = MoleHillTerrainSnapshot(BoundTerrainName="Site A", ReferenceMode="Bound", TerrainFrozen=False)  # -> Terrain, Name, Revision, Diagnostics, Key, Revision64, UnitSystem, MetersPerUnit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
terrain_snapshot_2 = MoleHillTerrainSnapshot(BoundTerrainName="Site B", ReferenceMode="Bound", TerrainFrozen=False)  # -> Terrain, Name, Revision, Diagnostics, Key, Revision64, UnitSystem, MetersPerUnit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
deterrain = DeconstructTerrain(Terrain=terrain_snapshot.Terrain)  # -> Mesh, Breaklines, Zones, ZoneNames, Name, Key, Revision, Diagnostics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
deterrain_2 = DeconstructTerrain(Terrain=terrain_snapshot_2.Terrain)  # -> Mesh, Breaklines, Zones, ZoneNames, Name, Key, Revision, Diagnostics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
